# Grasshopper definition 598-2.gh (Grasshopper 0.9.80)

number_slider = Slider(0.5, range=0..1)
number_slider_2 = Slider(0.1, range=0..1)
number = Number(-2)
division = Division(A=number_slider_2, B=number)
rectangle = Rectangle(Plane=PlaneXY(0, 0, 0), XSize=number_slider_2, YSize=number_slider, Radius=0)  # -> Rectangle, Length
vector_xyz = VectorXYZ(XComponent=division, YComponent=Slider(0.59, range=0..1), ZComponent=0)  # -> Vector, Length
rectangle_2 = Rectangle(Plane=PlaneXY(0, 0, 0), XSize=number_slider_2, YSize=number_slider, Radius=0)  # -> Rectangle, Length
multiplication = Multiplication(A=number_slider, B=Slider(-2.17, range=-5..5))
top_rect = Move(Geometry=rectangle.Rectangle, Motion=vector_xyz.Vector)  # -> Geometry, Transform
vector_xyz_2 = VectorXYZ(XComponent=division, YComponent=multiplication, ZComponent=0)  # -> Vector, Length
bottom_rect = Move(Geometry=rectangle_2.Rectangle, Motion=vector_xyz_2.Vector)  # -> Geometry, Transform
rectangle_3 = Rectangle(Plane=PlaneXY(0, 0, 0), XSize=number_slider, YSize=number_slider_2, Radius=0)  # -> Rectangle, Length
rectangle_4 = Rectangle(Plane=PlaneXY(0, 0, 0), XSize=number_slider, YSize=number_slider_2, Radius=0)  # -> Rectangle, Length
vector_xyz_3 = VectorXYZ(XComponent=Slider(-1.75, range=-5..1), YComponent=division, ZComponent=0)  # -> Vector, Length
vector_xyz_4 = VectorXYZ(XComponent=Slider(1.25, range=0..5), YComponent=division, ZComponent=0)  # -> Vector, Length
left_rect = Move(Geometry=rectangle_4.Rectangle, Motion=vector_xyz_3.Vector)  # -> Geometry, Transform
right_rect = Move(Geometry=rectangle_3.Rectangle, Motion=vector_xyz_4.Vector)  # -> Geometry, Transform
geometry = Geometry(<curve referenced from the Rhino model>)
region_difference = RegionDifference(CurvesA=geometry, CurvesB=left_rect.Geometry)
region_difference_2 = RegionDifference(CurvesA=region_difference, CurvesB=bottom_rect.Geometry)
region_difference_3 = RegionDifference(CurvesA=region_difference_2, CurvesB=right_rect.Geometry)
region_difference_4 = RegionDifference(CurvesA=region_difference_3, CurvesB=top_rect.Geometry)
